# Grasshopper definition MPDA_HNP_Final.gh (Grasshopper 1.0.8)

read_file = ReadFile(File="C:\Users\usuari\Documents\GitHub\MPDA_HNP\MPDA_surface.py", PerLineParse=False)
python_3_script = Python3Script(
    script=read_file,
    amp_h=Slider(5.262, range=0..50),
    amp_v=Slider(1, range=0..50),
    freq_h=Slider(3, range=0..50),
    freq_v=Slider(1, range=0..10),
    div_u=Slider(7, range=0..10),
    div_v=Slider(14, range=0..100),
    width=Slider(50, range=0..50),
    length=Slider(50, range=0..50),
    height=Slider(20, range=0..50))  # -> out, surface, mesh, points, strips_u, strips_v; unedited script template
srf = Surface(python_3_script.surface)
panel = Panel(python_3_script.surface)
mesh = Mesh(python_3_script.mesh)
crv = Curve(python_3_script.strips_v)
crv_2 = Curve(python_3_script.strips_u)
pt = Point(python_3_script.points)
pline = PolyLine(Vertices=pt, Closed=False)
polygon = Polygon(Plane=crv_2, Radius=3, Segments=6, FilletRadius=0)  # -> Polygon, Length
panel_2 = Panel("C:\Users\usuari\Documents\GitHub\MPDA_HNP\MPDA_NHP.py")  # disabled
read_file_2 = ReadFile(File=panel_2, PerLineParse=False)  # disabled
pt_2 = Point(python_3_script.points)  # disabled
read_file_3 = ReadFile(File="C:\Users\usuari\Documents\GitHub\MPDA_HNP\MPDA_Beam.py", PerLineParse=False)
python_3_script_2 = Python3Script(script=read_file_2, y=pt_2)  # -> out, a; disabled; unedited script template
python_3_script_3 = Python3Script(
    script_A=read_file_3,
    strips_u=crv_2,
    strips_v=crv,
    width=Slider(32, range=0..50),
    height=Slider(32, range=0..50),
    twist_deg=Slider(32, range=0..50),
    sections=Slider(32, range=0..50))  # -> breps, frames, profiles; unedited script template
pipe = Pipe(Radius=1, Caps=0, FitRail=False)
panel_3 = Panel(python_3_script_3.profiles)
rec = Rectangle(python_3_script_3.profiles)
